# Grasshopper definition CMF Compute Slope Run-off.gh (Grasshopper 0.9.76)
# plug-ins: Python Interpreter

# ----
# Slope Function
number_slider = Slider(0.25, range=0..1)
series = Series(Start="-3", Step=number_slider, Count=11)
sqr = Square(Value=series)

panel = Panel("C:\Users\Christian\Miniconda3\envs\livestock_env\python.exe")

# ----
# Livestock Setup
# Python and SSH
panel_2 = Panel("C:\Users\ocni\AppData\Local\Continuum\anaconda3\envs\livestock_env\python.exe")
python_executor = LivestockPythonExecutor(PythonPath=panel)  # -> readMe
#   port PythonPath: Path to python.exe
#   port readMe: In case of any errors, it will be shown here.
# ---------- python_executor: Python ----------
from livestock.components.misc import PythonExecutor

comp = PythonExecutor(ghenv)
comp.config()
comp.run_checks(str(PythonPath))
comp.run()
# ---------- end python_executor ----------
panel_3 = Panel(python_executor)

# ----
# X Direction
number_slider_2 = Slider(11, range=0..100)
series_2 = Series(Start=0, Step=Slider(2.5, range=0.5..5), Count=number_slider_2)

# ----
# 1. GEOMETRY
number_slider_3 = Slider(1, range=0..1)
pt = ConstructPoint(XCoordinate=series_2, YCoordinate=0, ZCoordinate=sqr)
pt_2 = ConstructPoint(XCoordinate=series_2, YCoordinate=number_slider_3, ZCoordinate=sqr)
weave = Weave(Pattern=[0, 1], Stream0=pt, Stream1=pt_2, NullGaps=False)
srfgrid = SurfaceFromPoints(Points=weave, UCount=number_slider_2, Interpolate=False)
mesh = MeshBrep(
    Brep=srfgrid,
    Settings={GridMaxCount=0, GridMinCount=16, JaggedSeams=False, MaxEdgeLength=0, MinEdgeLength=0.0001, MinTolerance=0, Refine=True, RefineAngle=0, RelativeTolerance=0.65, SimplePlanes=True, Tolerance=0})

# ---- group: Sort Faces
toggle = BooleanToggle(True)
faceb = FaceBoundaries(Mesh=mesh)
toggle_2 = BooleanToggle(False)
lng = ListLength(List=faceb)
dup = DuplicateData(Data=toggle, Number=expr("x-1", lng), Order=True)
dup_2 = DuplicateData(Data=toggle_2, Number=expr("x-1", lng), Order=True)
cullf = CullFaces(Mesh=mesh, Pattern=flatten([toggle_2, dup]))
cullf_2 = CullFaces(Mesh=mesh, Pattern=flatten([toggle, dup_2]))

# ----
# Soil Layers
number_slider_4 = Slider(0, range=0..2)
series_3 = Series(Start=Slider(0.1, range=0..1), Step=number_slider_4, Count=Slider(1, range=1..10))

# ----
# Soil Layers
number_slider_5 = Slider(0, range=0..2)
series_4 = Series(Start=Slider(0.1, range=0..1), Step=number_slider_5, Count=Slider(1, range=1..10))

# ----
# 2. GROUND
number_slider_6 = Slider(0, range=0..1)
cmf_ground = LivestockCMFGround(
    MeshFaces=cullf,
    Write=Toggle(True),
    Layers=series_3,
    GroundType=Slider(2, range=0..2),
    SurfaceWater=Slider(9, range=0..10),
    ETMethod=Slider(0, range=0..2),
    SurfaceRunOffMethod=number_slider_6)  # -> ReadMe, GroundData, Ground; inputs Layers: list
#   port Required: Below are the required inputs to make this component work
#   port MeshFaces: The mesh the where the ground properties should be applied.
#   port Write: Boolean to write the mesh to disk
#   port Optional: Below are the optional inputs to make this component work
#   port Layers: List of the depth of soil layers to add to the mesh in m. If the values 1 and 2 are given, two layers will be created. One from 0 to 1m and one from 1m to 2m. Default is 1m
#   port GroundType: Ground type to be applied. A number from 0-6 can be provided or the Livestock Ground Type component can be connected. 0 - Short grass with medium ground 1 - Gravel (light color and permeable) 2 - Pavement (dark color and non-permeable) Default is 0 - Short grass with medium ground
#   port SurfaceWater: Initial volume of surface water placed on each mesh face in m3. Default is set to 0m3
#   port ETMethod: Set method to calculate evapotranspiration. 0: No evapotranspiration 1: Penman-Monteith 2: Shuttleworth-Wallace Default is set to no evapotranspiratio.
#   port SurfaceRunOffMethod: Set the method for computing the surface run-off. 0 - Kinematic Wave. 1 - Diffusive Wave. Default is set 0 - Kinematic Wave.
#   port ReadMe: In case of any errors, it will be shown here.
#   port GroundData: Livestock Ground Data
#   port Ground: Livestock Ground Data Class
# ---------- cmf_ground: Python ----------
from livestock.components.comp_cmf import CMFGround

comp = CMFGround(ghenv)
comp.config()
comp.run_checks(MeshFaces, Write, Layers, GroundType, SurfaceWater, ETMethod,  
                SurfaceRunOffMethod)
                
comp.run(ghdoc)

GroundData = comp.ground_dict.items()
Ground = comp.results
# ---------- end cmf_ground ----------

# ----
# 2. GROUND
number_slider_7 = Slider(0, range=0..1)
number_slider_8 = Slider(0, range=0..2)
cmf_ground_2 = LivestockCMFGround(
    MeshFaces=cullf_2,
    Write=Toggle(True),
    Layers=series_4,
    GroundType=Slider(2, range=0..2),
    SurfaceWater=number_slider_8,
    ETMethod=number_slider_8,
    SurfaceRunOffMethod=number_slider_7)  # -> ReadMe, GroundData, Ground; inputs Layers: list
#   port Required: Below are the required inputs to make this component work
#   port MeshFaces: The mesh the where the ground properties should be applied.
#   port Write: Boolean to write the mesh to disk
#   port Optional: Below are the optional inputs to make this component work
#   port Layers: List of the depth of soil layers to add to the mesh in m. If the values 1 and 2 are given, two layers will be created. One from 0 to 1m and one from 1m to 2m. Default is 1m
#   port GroundType: Ground type to be applied. A number from 0-6 can be provided or the Livestock Ground Type component can be connected. 0 - Short grass with medium ground 1 - Gravel (light color and permeable) 2 - Pavement (dark color and non-permeable) Default is 0 - Short grass with medium ground
#   port SurfaceWater: Initial volume of surface water placed on each mesh face in m3. Default is set to 0m3
#   port ETMethod: Set method to calculate evapotranspiration. 0: No evapotranspiration 1: Penman-Monteith 2: Shuttleworth-Wallace Default is set to no evapotranspiratio.
#   port SurfaceRunOffMethod: Set the method for computing the surface run-off. 0 - Kinematic Wave. 1 - Diffusive Wave. Default is set 0 - Kinematic Wave.
#   port ReadMe: In case of any errors, it will be shown here.
#   port GroundData: Livestock Ground Data
#   port Ground: Livestock Ground Data Class
# ---------- cmf_ground_2: Python ----------
from livestock.components.comp_cmf import CMFGround

comp = CMFGround(ghenv)
comp.config()
comp.run_checks(MeshFaces, Write, Layers, GroundType, SurfaceWater, ETMethod,  
                SurfaceRunOffMethod)
comp.run(ghdoc)

GroundData = comp.ground_dict.items()
Ground = comp.results
# ---------- end cmf_ground_2 ----------

panel_4 = Panel(cmf_ground_2.GroundData)

faceb_2 = FaceBoundaries(Mesh=mesh)
Z = UnitZ(Factor=series_3)
Z_2 = UnitZ(Factor=expr("-x", series_3))  # -> graft(UnitVector)
# Visualize Geometry
extr = Extrude(Base=faceb_2, Direction=Z)
move = Move(Geometry=extr, Motion=Z_2)  # -> Geometry, Transform
wires = BrepWireframe(Brep=move.Geometry, Density=-1)  # -> simplify(Wireframe)

panel_5 = Panel("""6
s""")

# ----
# 4. SOLVE
panel_6 = Panel("C:\Users\ocni\PycharmProjects\livestock_gh\grasshopper\tests\test_data")
panel_7 = Panel("C:\Users\Christian\Dropbox\Arbejde\DTU BYG\Livestock\livestock_gh\grasshopper\tests\test_data")
cmf_solve = LivestockCMFSolve(
    Ground=[cmf_ground.Ground, cmf_ground_2.Ground],
    Write=Toggle(False),
    Run=Toggle(False),
    CaseName="CMF_Slope_v0",
    Folder=panel_7,
    SSH=Toggle(False))  # -> ReadMe, ResultPath; inputs Ground: list, Trees: list, BoundaryConditions: list
#   port Required: Below are the required inputs to make this component work
#   port Ground: Output from Livestock CMF Ground
#   port Write: Boolean to write files
#   port Run: Boolean to run analysis
#   port Optional: Below are the optional inputs to make this component work
#   port Weather: Input from Livestock CMF Weather
#   port Trees: Input from Livestock CMF Tree
#   port BoundaryConditions: Input from Livestock CMF Boundary Condition
#   port SolverSettings: Input from Livestock CMF Solver Settings
#   port Outputs: Connect Livestock Outputs
#   port CaseName: Case name as string. Default is: unnamed_cmf_case
#   port Folder: Path to case folder. Default is C:/livestock/analyses
#   port SSH: If True the case will be computed through the SSH connection.To get the SSH connection to work; the Livestock SSH Component should be configured. If False; the case will be run locally. Default is set to False
#   port ReadMe: In case of any errors, it will be shown here.
#   port ResultPath: Path to result files
# ---------- cmf_solve: Python ----------
from livestock.components.comp_cmf import CMFSolve

comp = CMFSolve(ghenv)
comp.config()
comp.run_checks(Ground, Write, Run, Weather, Trees, BoundaryConditions, 
                SolverSettings, Outputs, CaseName, Folder, SSH)
comp.run(ghdoc)
#print(comp.case_path)
ResultPath = comp.case_path
# ---------- end cmf_solve ----------
panel_8 = Panel(cmf_solve.ReadMe)

panel_9 = Panel("""1
s""")

# ----
# Solver Settings & Outputs
number_slider_9 = Slider(-5, range=-10..-2, expression="10^x")
panel_10 = Panel("""2
1
2005""")
cmf_outputs = LivestockCMFOutputs(SurfaceWaterVolume=Toggle(False), Volume=Toggle(False))  # -> ReadMe, ChosenOutputs, Outputs
#   port Optional: Below are the optional inputs to make this component work
#   port Evapotranspiration: Cell evaporation Default is set to False
#   port SurfaceWaterVolume: Cell surface water Default is set to True
#   port SurfaceWaterFlux: Cell surface water flux Default is set to False
#   port HeatFlux: Cell surface heat flux Default is set to False
#   port VolumetricFlux: Soil layer volumetric flux vectors Default is set to False
#   port Potential: Soil layer total potential (Psi_tot = Psi_M + Psi_G) Default is set to False
#   port Theta: Soil layer volumetric water content of the layer Default is set to False
#   port Volume: Soil layer volume of water in the layer Default is set to True
#   port Wetness: Soil layer wetness of the soil (V_volume/V_pores) Default is set to False
#   port ReadMe: In case of any errors, it will be shown here.
#   port ChosenOutputs: Shows the chosen outputs
#   port Outputs: Livestock Output Data
# ---------- cmf_outputs: Python ----------
from livestock.components.comp_cmf import CMFOutputs

comp = CMFOutputs(ghenv)
comp.config()
comp.run_checks(Evapotranspiration, SurfaceWaterVolume, SurfaceWaterFlux, 
                HeatFlux, VolumetricFlux, Potential, 
                Theta, Volume, Wetness)
comp.run()

ChosenOutputs = comp.output_dict.items()
Outputs = comp.results
# ---------- end cmf_outputs ----------
cmf_solver_settings = LivestockCMFSolverSettings(AnalysisLength=panel_5, TimeStep=panel_9, StartTime=panel_10, SolverTolerance=number_slider_9)  # -> ReadMe, ChosenSolverSettings, SolverSettings; inputs AnalysisLength: list, TimeStep: list, StartTime: list
#   port Optional: Below are the optional inputs to make this component work
#   port AnalysisLength: Total length of the simulation.The input should be a list with two values. The first value is the numerical length e.g. 24. Second value is the time unit e.g. h for hour. The second option is optional and if not giventhe time unit is set to hours. The time unit has to be one of the following values: y - year d - day h - hour m - minute s - second Default is set to 24 hours.
#   port TimeStep: Size of each simulation time step.The input should be a list with two values. The first value is the numerical length e.g. 24. Second value is the time unit e.g. h for hour. The second option is optional and if not giventhe time unit is set to hours. The time unit has to be one of the following values: y - year d - day h - hour m - minute s - second Default is 1 hour
#   port StartTime: Sets the start time for the simulation. The input should be a list with three values. The first value is the day. Second value is the month. Third value is the year. All values should be integers and they all start from 1. Default is 01-01-[current year]
#   port SolverTolerance: Solver tolerance Default is 1e-8
#   port ReadMe: In case of any errors, it will be shown here.
#   port ChosenSolverSettings: Shows the chosen solver settings
#   port SolverSettings: Livestock Solver Settings
# ---------- cmf_solver_settings: Python ----------
from livestock.components.comp_cmf import CMFSolverSettings

comp = CMFSolverSettings(ghenv)
comp.config()
comp.run_checks(AnalysisLength, TimeStep, StartTime, SolverTolerance)
comp.run()

ChosenSolverSettings = comp.settings_dict.items()
SolverSettings = comp.results
# ---------- end cmf_solver_settings ----------

preview = CustomPreview(Geometry=wires, Shader=ColourSwatch(SwatchColor=RGB(0, 0, 0)))
preview_2 = CustomPreview(Geometry=mesh, Shader=ColourSwatch(SwatchColor=RGB(203, 162, 125)))

# ----
# 4. SOLVE
panel_11 = Panel("C:\Users\Christian\Dropbox\Arbejde\DTU BYG\Livestock\livestock_gh\grasshopper\tests\test_data")
cmf_solve_2 = LivestockCMFSolve(
    Ground=[cmf_ground.Ground, cmf_ground_2.Ground],
    Write=Toggle(False),
    Run=Toggle(False),
    SolverSettings=cmf_solver_settings.SolverSettings,
    CaseName="CMF_Slope_sec_v0",
    Folder=panel_11,
    SSH=Toggle(False))  # -> ReadMe, ResultPath; inputs Ground: list, Trees: list, BoundaryConditions: list; same code as cmf_solve
panel_12 = Panel(cmf_solve_2.ReadMe)

panel_13 = Panel(cmf_outputs.ChosenOutputs)
panel_14 = Panel(cmf_solver_settings.ChosenSolverSettings)
